# Grasshopper definition grid.gh (Grasshopper 1.0.7)
# plug-ins: Human, Pufferfish, Anemone

dir = DirectoryContents(FolderPath="C:\cWeb\projects\skies-next\public\images\skies", Filter="*", IncludeSubfolders=False)  # -> FilePaths, FileNames
rectangle = Rectangle(Plane=PlaneXY(0, 0, 0), XSize=Domain(-1, 1), YSize=Domain(-2, 2), Radius=0)  # -> Rectangle, Length
rec = Rectangle({Plane=PlaneXY(58.10965163, 7.5385494, 0), Size=Domain2(u=-153.4408909..153.4408909, v=-206.2107367..206.2107367)})
split = TextSplit(Text=dir.FilePaths, Separators=".")
dir_2 = DirectoryContents(FolderPath="C:\cWeb\projects\skies-next\public\images\atlas", Filter="*", IncludeSubfolders=False)  # -> FilePaths, FileNames
item = ListItem(List=split, Index="2", Wrap=True)  # -> flatten(Item)
concat = Concatenate(FragmentA="\"", FragmentB=dir.FileNames, FragmentE=".", FragmentF=item, FragmentC="\"", FragmentD=",")
boundary = BoundarySurfaces(Edges=rec)
sqrt = SquareRoot(Value="16")
brec = BoundingRectangle(Geometry=rec, Plane=PlaneXY(0, 0, 0), Axis=0, Slide=0, Union=True)  # -> Bounding, DimensionX, DimensionY
number_slider = Slider(10, range=0..10)
number_slider_2 = Slider(0, range=0..11)
partition = PartitionList(List=dir.FilePaths, Size="16")
brec_2 = BoundingRectangle(Plane=PlaneXY(0, 0, 0), Axis=0, Slide=0, Union=True)  # -> Bounding, DimensionX, DimensionY
divide = DivideDomain²(Domain=boundary, UCount=sqrt, VCount=sqrt)
panel = Panel(".")
tstat = TreeStatistics(Tree=partition)  # -> Paths, Length, Count
lng = ListLength(List=tstat.Paths)  # -> expr("x-1", Length)
subsrf = Isotrim(Surface=boundary, Domain=divide)
panel_2 = Panel("2048")
panel_3 = Panel("4096")
concat_2 = Concatenate(FragmentA="\"", FragmentB=dir_2.FileNames, FragmentC="\"", FragmentD=",")
cull_i = CullIndex(List=tstat.Paths, Indices=lng, Wrap=True)
division = Division(A=Slider(1024, range=0..10000), B=brec.DimensionX)
branch = TreeBranch(Tree=partition, Path=cull_i, MaintainPaths=True)
tstat_2 = TreeStatistics(Tree=branch)  # -> Paths, Length, Count
smesh = SimpleMesh(Brep=subsrf)
loop_start = LoopStart(Repeat=lng, Trigger=Button(), Data="0")  # -> port, Counter, Data
item_2 = ListItem(List=tstat_2.Paths, Index=loop_start.Counter, Wrap=True)
branch_2 = TreeBranch(Tree=partition, Path=item_2, MaintainPaths=True)
surfacemap = SurfaceMapping(Mesh=smesh, Surface=subsrf)
panel_4 = Panel(concat_2)
previewmat = CustomPreviewMaterials(Geometry=surfacemap, DiffuseColor=RGB(255, 255, 255), DiffuseBitmap=branch_2)
geo = Geometry(brec.Bounding)
panel_5 = Panel(loop_start.Counter)
addition = Addition(A=loop_start.Data, B=1)
loop_end = LoopEnd(port=loop_start.port, Exit=False, Data=addition, TimeOutVal=0, pausedState=False, state="Constant output")
panel_6 = Panel("atlas_2")
save = Button()
concat_3 = Concatenate(FragmentB=loop_end)
python = GhPythonScript(
    frame=geo,
    factor=division,
    path="C:\cWeb\projects\skies-next\public\images\atlas\",
    filename=concat_3,
    save=Toggle(True))  # -> out; inputs frame: Polyline, save: Boolean
# ---------- python: Python ----------
import Rhino.Geometry as rg
import Rhino.Display as rd
import scriptcontext as sc
import System, operator

# Get x and y coordinates of frame vertices
px, py = set(frame.X), set(frame.Y)

# Get horizontal and vertical lengths
dx = abs(reduce(operator.sub, px))
dy = abs(reduce(operator.sub, py))

# Construct the points that will set the print area
offx = (dx/dy) * (3/factor)
offy = (dy/dx )* (3/factor)
p1 = rg.Point3d(min(px) + offx, min(py) + offy, 0)
p2 = rg.Point3d(max(px) - offx, max(py) - offy, 0)

# Set resolution to chosen scaling factor
sx, sy = dx*factor, dy*factor


def Capture():

    view = sc.doc.Views.ActiveView
    size = System.Drawing.Size(sx, sy) 

    settings = rd.ViewCaptureSettings(view, size, 300) #view, size, dpi
    settings.SetWindowRect(p1, p2)
    settings.RasterMode = True
    settings.DrawGrid = False
    settings.DrawAxis = False
    settings.DrawWallpaper = False

    bitmap = rd.ViewCapture.CaptureToBitmap(settings)
    bitmap.Save(path+filename+".jpg")


if save:
    Capture()
# ---------- end python ----------
equals = Equality(FirstNumber=loop_start.Counter, SecondNumber="1")  # -> Equality, Inequality
output_path = Panel(concat_3)
