# Grasshopper definition grid_005.gh (Grasshopper 1.0.7)
# plug-ins: Human, Pancake, Pufferfish

panel = Panel("C:\Users\Matthew\OneDrive\My Documents\home\projects\skies-denver\Masks & Models\Masks _ Models\2D Masks\_USE THIS MASK_\mask.svg")
pcimportsvg = ImportSVG(File=panel, LastSaveLocalization="neutral,N")
panel_2 = Panel("""1
1
2
4
4
8
2
4
4
8
8
16""")
rotate = Rotate(Geometry=pcimportsvg, Angle=1.570796327, Plane=PlaneXY(0, 0, 0))  # -> Geometry, Transform
partition = PartitionList(List=panel_2, Size="2")
panel_3 = Panel("""4
8""")
branch = TreeBranch(Tree=simplify(partition), Path=Slider(4, range=0..12), MaintainPaths=True)
panel_4 = Panel(branch)
item = ListItem(List=rotate.Transform, Index=0, Wrap=True)
line = Line(Line((0.55, -268.58952, 0), (3438.55, -268.58952, 0)))
brec = BoundingRectangle(Geometry=rotate.Geometry, Plane=PlaneXY(0, 0, 0), Axis=0, Slide=0, Union=True)  # -> Bounding, DimensionX, DimensionY
rec = Rectangle(brec.Bounding)
boundary = BoundarySurfaces(Edges=rec)  # -> reparameterize(Surfaces)
explode = Explode(Curve=brec.Bounding, Recursive=True)  # -> Segments, Vertices
area = Area(Geometry=rotate.Geometry)  # -> Area, Centroid
dir = DirectoryContents(FolderPath="C:\cWeb\projects\skies-media\public\images\skies", Filter="*", IncludeSubfolders=False)  # -> FilePaths, FileNames
divide = DivideDomain²(Domain=boundary, UCount="8", VCount="16")
item_2 = ListItem(List=explode.Segments, Index=Slider(0, range=0..3), Wrap=True)
transform = Transform(Geometry=line, Transform=item)
sort = SortList(Keys=area.Area, ValuesA=rotate.Geometry)  # -> Keys, reverse(ValuesA)
item_3 = ListItem(List=branch, Index=0, Wrap=True)  # -> Item, Item1
divide_2 = DivideDomain²(Domain=boundary, UCount=item_3.Item, VCount=item_3.Item1)
division = Division(A=brec.DimensionY, B=brec.DimensionX)
number_slider = Slider(8, range=0..10)
dir_2 = DirectoryContents(FolderPath="C:\cWeb\projects\skies-next\public\images\atlas", Filter="*", IncludeSubfolders=False)  # -> FilePaths, FileNames
subsrf = Isotrim(Surface=boundary, Domain=divide_2)
subsrf_2 = Isotrim(Surface=boundary, Domain=divide)
panel_5 = Panel(division)
number_slider_2 = Slider(1.1, range=0..10)
split = SplitList(List=sort.ValuesA, Index="1")  # -> ListA, ListB
edges = BrepEdges(Brep=subsrf)  # -> Naked, Interior, NonManifold
area_2 = Area(Geometry=subsrf_2)  # -> Area, Centroid
concat = Concatenate(FragmentA="\"", FragmentB=dir.FileNames, FragmentC="\"", FragmentD=",")
scale = Scale(Geometry=subsrf_2, Center=area_2.Centroid, Factor="1")  # -> Geometry, Transform
divide_3 = DivideDomain²(Domain=boundary, UCount="3", VCount="9")
boundary_2 = BoundarySurfaces(Edges=split.ListB)
split_2 = SplitList(List=concat, Index=Slider(20, range=0..100))  # -> ListA, ListB
rec_2 = Rectangle(brec.Bounding)
subsrf_3 = Isotrim(Surface=boundary, Domain=divide_3)
area_3 = Area(Geometry=subsrf_3)  # -> Area, Centroid
disc = Discontinuity(Curve=boundary_2, Level=Slider(3, range=1..3))  # -> Points, Parameters
pull = PullPoint(Point=flatten(disc.Points), Geometry=item_2, ClosestOnly=True)  # -> ClosestPoint, Distance
pull_2 = PullPoint(Point=flatten(disc.Points), Geometry=transform, ClosestOnly=True)  # -> ClosestPoint, Distance
smaller = SmallerThan(FirstNumber=pull.Distance, SecondNumber="0.03")  # -> SmallerThan, OrEqualTo
scale_2 = Scale(Geometry=subsrf_3, Center=area_3.Centroid, Factor="1")  # -> Geometry, Transform
smaller_2 = SmallerThan(FirstNumber=pull_2.Distance, SecondNumber="10")  # -> SmallerThan, OrEqualTo
edges_2 = BrepEdges(Brep=scale.Geometry)  # -> Naked, Interior, NonManifold
join = TextJoin(Text=split_2.ListA)
smesh = SimpleMesh(Brep=subsrf)
dispatch = Dispatch(List=flatten(disc.Points), DispatchPattern=smaller.SmallerThan)  # -> ListA, ListB
join_2 = JoinCurves(Curves=edges_2.Naked, Preserve=False)
lng = ListLength(List=flatten(join_2))
end = EndPoints(Curve=item_2)  # -> Start, End
edges_3 = BrepEdges(Brep=scale_2.Geometry)  # -> Naked, Interior, NonManifold
dispatch_2 = Dispatch(List=flatten(disc.Points), DispatchPattern=smaller_2.SmallerThan)  # -> ListA, ListB
end_2 = EndPoints(Curve=transform)  # -> Start, End
tri = Triangulate(Mesh=smesh)  # -> Mesh, Count
lng_2 = ListLength(List=tri.Mesh)
lng_3 = ListLength(List=tri.Mesh)
lng_4 = ListLength(List=subsrf)
area_4 = Area(Geometry=tri.Mesh)  # -> Area, Centroid
pt = Point(dispatch.ListA)
concat_2 = Concatenate(FragmentA="export const fileNames = [", FragmentB=join, FragmentC="]")
join_3 = JoinCurves(Curves=edges_3.Naked, Preserve=False)
series = Series(Start=0, Step=1, Count=lng_2)
merge = Merge(Data1=end.Start, Data2=end.End)
pt_2 = Point(dispatch_2.ListA)
lng_5 = ListLength(List=pt)
merge_2 = Merge(Data1=end_2.Start, Data2=end_2.End)
lng_6 = ListLength(List=pt_2)
incurve = PointInCurve(Point=area_4.Centroid, Curve=join_2)  # -> Relationship, Point
panel_6 = Panel(".")
series_2 = Series(Start=0, Step=1, Count=lng_4)
area_5 = Area(Geometry=tri.Mesh)  # -> Area, Centroid
series_3 = Series(Start=0, Step=1, Count=lng_3)
boundary_3 = BoundarySurfaces(Edges=split.ListA)
dispatch_3 = Dispatch(List=tri.Mesh, DispatchPattern=incurve.Relationship)  # -> ListA, ListB
data = Data(dispatch_3.ListA)
surfacemap = SurfaceMapping(Mesh=data, Surface=graft(scale.Geometry))  # -> simplify(graft(MappedMesh))
dispatch_4 = Dispatch(List=series, DispatchPattern=incurve.Relationship)  # -> flatten(ListA), ListB
concat_3 = Concatenate(FragmentA="\"", FragmentB=dir_2.FileNames, FragmentC="\"", FragmentD=",")
surfacemap_2 = SurfaceMapping(Mesh=tri.Mesh, Surface=boundary)  # -> graft(MappedMesh)
previewlw = CustomPreviewLineweights(
    Geometry=join_2,
    Shader={diffuse=RGB(255, 105, 180), emission=RGB(76, 32, 54), shine=0.5, specular=RGB(255, 255, 255), transparency=0},
    Thickness=Slider(17, range=0..100),
    Absolute=False)
incurve_2 = PointInCurve(Point=area_5.Centroid, Curve=join_3)  # -> Relationship, Point
wrtietext = WrtieText(filePath="C:\cWeb\projects\skies-media\src\data\fileNames.ts", data=concat_2, activate=Toggle(True))  # -> out, A; inputs data: list
# ---------- wrtietext: VB ----------
    If activate Then

      Dim i As Integer
      Dim aryText(4) As String

      aryText(0) = "Mary WriteLine"
      aryText(1) = "Had"
      aryText(2) = "Another"
      aryText(3) = "Little"
      aryText(4) = "One"

      ' the data is appended to the file. If file doesnt exist, a new file is created
      Dim objWriter As New System.IO.StreamWriter(filePath, append)

      For i = 0 To data.Count - 1
        objWriter.WriteLine(data(i))
      Next

      objWriter.Close()

    End If

    If clearFile Then
      Dim objWriter As New System.IO.StreamWriter(filePath, False)
      objWriter.Close()
    End If
# ---------- end wrtietext ----------
mjoin = MeshJoin(Meshes=graft(tri.Mesh))
series_4 = Series(Start=0, Step=1, Count=lng)
dispatch_5 = Dispatch(List=tri.Mesh, DispatchPattern=incurve_2.Relationship)  # -> ListA, ListB
data_2 = Data(dispatch_5.ListA)
surfacemap_3 = SurfaceMapping(Mesh=data_2, Surface=graft(scale_2.Geometry))  # -> simplify(graft(MappedMesh))
dispatch_6 = Dispatch(List=series_3, DispatchPattern=incurve_2.Relationship)  # -> flatten(ListA), ListB
item_4 = ListItem(List=dir.FilePaths, Index=series_2, Wrap=True)
item_5 = ListItem(List=dir.FilePaths, Index="4", Wrap=True)
previewlw_2 = CustomPreviewLineweights(
    Geometry=join_3,
    Shader={diffuse=RGB(255, 105, 180), emission=RGB(76, 32, 54), shine=0.5, specular=RGB(255, 255, 255), transparency=0},
    Thickness=Slider(17, range=0..100),
    Absolute=False)
ins = InsertItems(List=pt_2, Item=merge_2, Indices=flatten(["0", lng_6]), Wrap=True)
ins_2 = InsertItems(List=pt, Item=merge, Indices=flatten(["0", lng_5]), Wrap=True)
cullpt = CullDuplicates(Points=ins, Tolerance=Slider(4, range=0..10), CullMode=3)  # -> Points, Indices, Valence
de_code_mesh = DeCodeMesh(m=surfacemap_2)  # -> F, V, C, N, UVs; inputs m: Mesh
# ---------- de_code_mesh: Python ----------
"""Extract Mesh UV coordinates
    Inputs:
        m: Mesh to extract UV coordinates from
    Output:
        F: List of faces
        V: List of vertices
        C: List of vertex colors, if they exist
        N: List of face normals, if they exist
        UVs: List of texture coordinates (UVs), if they exist"""

__author__ = "Nathan"
__version__ = "2018.07.20"

import rhinoscriptsyntax as rs

if not m==None:
    F = m.Faces
    V = m.Vertices
    N = m.FaceNormals
    C = m.VertexColors
    UVs = m.TextureCoordinates
# ---------- end de_code_mesh ----------
sort_2 = SortList(Keys=dispatch_6.ListA, ValuesA=flatten(surfacemap_3))  # -> Keys, ValuesA
sort_3 = SortList(Keys=dispatch_4.ListA, ValuesA=flatten(surfacemap))  # -> Keys, ValuesA
graft = GraftTree(Tree=flatten(sort_3.ValuesA), IncludeEmptyLists=True, IncludeNullItems=True)  # -> graft(Tree)
graft_2 = GraftTree(Tree=flatten(sort_2.ValuesA), IncludeEmptyLists=True, IncludeNullItems=True)  # -> graft(Tree)
de_code_mesh_2 = DeCodeMesh(m=graft)  # -> F, V, C, N, simplify(UVs); inputs m: Mesh; same code as de_code_mesh
de_code_mesh_3 = DeCodeMesh(m=graft_2)  # -> F, V, C, N, simplify(UVs); inputs m: Mesh; same code as de_code_mesh
srf = Surface(reparameterize(boundary_3))
number_slider_3 = Slider(33, range=0..100)
srf_cp = SurfaceClosestPoint(Point=cullpt.Points, Surface=srf)  # -> Point, UVPoint, Distance
pdecon = Deconstruct(Point=srf_cp.UVPoint)  # -> XComponent, YComponent, ZComponent
srf_cp_2 = SurfaceClosestPoint(Point=ins_2, Surface=srf)  # -> Point, UVPoint, Distance
pdecon_2 = Deconstruct(Point=srf_cp_2.UVPoint)  # -> XComponent, YComponent, ZComponent
sort_4 = SortList(Keys=pdecon_2.YComponent)  # -> Keys, ValuesA
data_3 = Data(["`/Sky_01/sky_342.jpg`,", "`/www.google.com/pink_sky_-_Google_Search/10001.jpg`,", "`/home/20220302_183618.jpg`,", "`/www.google.com/pink_sky_-_Google_Search/10063.jpg`,", "`/www.google.com/pink_sky_-_Google_Search/10022 (1).jpg`,", "`/Sky_01/sky_315.jpg`,", "`/www.google.com/pink_sky_-_Google_Search/10066.jpg`,", "`/www.google.com/pink_sky_-_Google_Search/10069.jpg`,", "`/www.google.com/pink_sky_-_Google_Search/10064.jpg`,", "`/www.google.com/pink_sky_-_Google_Search/10012 (1).jpg`,", "`/www.google.com/pink_sky_-_Google_Search/10042.jpg`,", "`/www.google.com/pink_sky_-_Google_Search/10017.jpg`,", "`/www.google.com/sky_sunset_pink_clouds_-_Google_Search/10057.jpg`,", "`/www.google.com/pink_sky_-_Google_Search/10059.jpg`,", "`/www.google.com/pink_sky_-_Google_Search/10057.jpg`,", "`/www.google.com/pink_sky_-_Google_Search/10068 (1).jpg`,", "`/www.google.com/pink_sky_-_Google_Search/10066 (1).jpg`,", "`/Sky_01/sky_234.jpg`,", "`/www.google.com/sky_sunset_pink_clouds_-_Google_Search/10045.jpg`,", "`/www.google.com/sky_sunset_pink_clouds_-_Google_Search/10017.jpg`,", "`/www.google.com/sky_sunset_pink_clouds_-_Google_Search/10001.jpg`,", "`/www.google.com/pink_sky_-_Google_Search/10051.jpg`,", "`/home/20220706_213820_1.jpg`,", "`/www.google.com/sky_sunset_pink_clouds_-_Google_Search/10052.jpg`,", "`/www.google.com/pink_sky_-_Google_Search/10037 (1).jpg`,", "`/www.google.com/sky_sunset_pink_clouds_-_Google_Search/10040.jpg`,", "`/www.google.com/sky_sunset_pink_clouds_-_Google_Search/10039.jpg`,", "`/www.google.com/pink_sky_-_Google_Search/10059 (1).jpg`,", "`/Sky_02/sky.arena_68.jpg`,", "`/www.google.com/sky_sunset_pink_clouds_-_Google_Search/10065.jpg`,", "`/Sky_02/sky.arena_52.jpg`,", "`/www.google.com/sky_sunset_pink_clouds_-_Google_Search/10033.jpg`,", "`/www.google.com/sky_sunset_pink_clouds_-_Google_Search/10055.jpg`,", "`/www.google.com/pink_sky_-_Google_Search/10043.jpg`,", "`/www.google.com/pink_sky_-_Google_Search/10013.jpg`,", "`/www.google.com/pink_sky_-_Google_Search/10010.jpg`,", "`/www.google.com/pink_sky_-_Google_Search/10016.jpg`,", "`/www.google.com/pink_sky_-_Google_Search/10026.jpg`,", "`/Sky_02/sky.arena_38.jpg`,", "`/www.google.com/01/10056.jpg`,", "`/www.google.com/pink_sky_-_Google_Search/10012.jpg`,", "`/www.google.com/pink_sky_-_Google_Search/10041.jpg`,"])
panel_7 = Panel(concat_2)
panel_8 = Panel("-1")
sort_5 = SortList(Keys=pdecon.XComponent)  # -> Keys, ValuesA
shift = ShiftList(List=sort_4.Keys, Shift=1, Wrap=False)
item_6 = ListItem(List=data_3, Index=series_4, Wrap=True)
repeat = RepeatData(Data=item_6, Length=lng_2)
shift_2 = ShiftList(List=sort_5.Keys, Shift=1, Wrap=False)
lng_7 = ListLength(List=sort_4.Keys)  # -> expr("x-1", Length)
entwine = Entwine(
    Branch0X=simplify(de_code_mesh.UVs),
    Branch1X=simplify(de_code_mesh_2.UVs),
    Branch2X=simplify(de_code_mesh_3.UVs),
    Branch3X=simplify(de_code_mesh_3.UVs),
    Branch4X=simplify(de_code_mesh.UVs),
    Branch5X=de_code_mesh_3.UVs,
    FlattenInputs=False)  # -> simplify(Result)
item_7 = ListItem(List=flatten(graft), Index=number_slider_3, Wrap=True)
item_8 = ListItem(List=flatten(surfacemap_2), Index=number_slider_3, Wrap=True)
concat_4 = Concatenate(FragmentA=sort_4.Keys, FragmentB=" To ", FragmentC=shift)
lng_8 = ListLength(List=sort_5.Keys)  # -> expr("x-1", Length)
move = Move(Geometry=boundary_2, Motion=Vector(0, 0, 10))  # -> Geometry, Transform
concat_5 = Concatenate(FragmentA=sort_5.Keys, FragmentB=" To ", FragmentC=shift_2)
previewmat = CustomPreviewMaterials(Geometry=surfacemap_2, DiffuseColor=RGB(255, 255, 255), Transparency=Slider(0, range=0..1), DiffuseBitmap=graft(item_5))
cull_i = CullIndex(List=concat_4, Indices=lng_7, Wrap=True)
cull_i_2 = CullIndex(List=concat_5, Indices=lng_8, Wrap=True)
panel_9 = Panel(repeat)
dom² = ConstructDomain²(DomainU=graft(cull_i_2), DomainV=cull_i)
subsrf_4 = Isotrim(Surface=srf, Domain=dom²)
mesh = Mesh(mjoin)
brec_2 = BoundingRectangle(Geometry=flatten(mesh), Plane=PlaneXY(0, 0, 0), Axis=0, Slide=0, Union=True)  # -> Bounding, DimensionX, DimensionY
division_2 = Division(A="1", B=brec_2.DimensionY)
area_6 = Area(Geometry=brec_2.Bounding)  # -> Area, Centroid
rev = Reverse(Vector=area_6.Centroid)
move_2 = Move(Geometry=mesh, Motion=rev)  # -> Geometry, Transform
smesh_2 = SimpleMesh(Brep=subsrf_4)
surfacemap_4 = SurfaceMapping(Mesh=smesh_2, Surface=subsrf_4)
lng_9 = ListLength(List=flatten(surfacemap_4))
scale_3 = Scale(Geometry=move_2.Geometry, Center=Point(0, 0, 0), Factor=division_2)  # -> Geometry, Transform
round_point = RoundPoint(data=entwine, data_2="5")
round_point_2 = RoundPoint(data=de_code_mesh.UVs, data_2="5")
dir_3 = DirectoryContents(FolderPath="C:\cWeb\projects\skies-next\public\images\skies", Filter="*", IncludeSubfolders=False)  # -> FilePaths, FileNames
pdecon_3 = Deconstruct(Point=round_point)  # -> XComponent, YComponent, ZComponent
repeat_2 = RepeatData(Data=dir_3.FilePaths, Length=lng_9)
previewmat_2 = CustomPreviewMaterials(Geometry=flatten(surfacemap_4), DiffuseColor=RGB(255, 255, 255), DiffuseBitmap=repeat_2)
demesh = DeconstructMesh(Mesh=scale_3.Geometry)  # -> Vertices, simplify(Faces), Colours, Normals
pdecon_4 = Deconstruct(Point=round_point_2)  # -> XComponent, YComponent, ZComponent
panel_10 = Panel(round_point)
concat_6 = Concatenate(FragmentA=pdecon_3.YComponent, FragmentD=",", FragmentB=pdecon_3.XComponent, FragmentE=",")
concat_7 = Concatenate(FragmentA=pdecon_4.YComponent, FragmentD=",", FragmentB=pdecon_4.XComponent, FragmentE=",")
join_4 = TextJoin(Text=concat_6)
join_5 = TextJoin(Text=concat_7)
facetoarr = FaceToArr(T=demesh.Faces)
pdecon_5 = Deconstruct(Point=demesh.Vertices)  # -> XComponent, YComponent, ZComponent
concat_8 = Concatenate(FragmentA="[", FragmentB=join_4, FragmentC="]", FragmentD=",")
join_6 = TextJoin(Text=facetoarr)
concat_9 = Concatenate(FragmentA="[", FragmentB=join_5, FragmentC="]", FragmentD=",")
concat_10 = Concatenate(
    FragmentA=pdecon_5.XComponent,
    FragmentD=",",
    FragmentB=pdecon_5.YComponent,
    FragmentE=",",
    FragmentC=pdecon_5.ZComponent,
    FragmentF=",")
shift_paths = ShiftPaths(data=concat_8)
join_7 = TextJoin(Text=concat_10)
concat_11 = Concatenate(FragmentA="[", FragmentB=join_6, FragmentC="]", FragmentD=",")
flip = FlipMatrix(Data=shift_paths)
join_8 = TextJoin(Text=flatten(concat_9))
concat_12 = Concatenate(FragmentA="[", FragmentB=join_7, FragmentC="]", FragmentD=",")
concat_13 = Concatenate(FragmentA="export const MASK_UVS = [", FragmentB=join_8, FragmentC="]")
join_9 = TextJoin(Text=flip)
concat_14 = Concatenate(FragmentA="[", FragmentB=join_9, FragmentC="]", FragmentD=",")
concat_15 = Concatenate(FragmentE="{", FragmentA="ids: ", FragmentB=concat_11, FragmentD="position:", FragmentC=concat_12, FragmentF="},")
join_10 = TextJoin(Text=flatten(concat_14))
join_11 = TextJoin(Text=flatten(concat_15))
concat_16 = Concatenate(FragmentA="export const meshData = [", FragmentC=join_11, FragmentB="]")
concat_17 = Concatenate(FragmentA="export const UVARRAY = [", FragmentB=join_10, FragmentC="]")
concat_18 = Concatenate(FragmentE=concat_16, FragmentC=concat_13, FragmentB=concat_17)
panel_11 = Panel(concat_16)
join_12 = TextJoin(Text=concat_18)
panel_12 = Panel(join_12)
wrtietext_2 = WrtieText(filePath="C:\cWeb\projects\skies-media\src\data\meshData.ts", data=join_12, activate=Toggle(True))  # -> out, A; inputs data: list; same code as wrtietext

# ==== cluster FaceToArr
T = ClusterInput()
rep = ReplaceText(Text=T, Find="T", RecursiveReplace=False)
rep_2 = ReplaceText(Text=rep, Find="{", RecursiveReplace=False)
rep_3 = ReplaceText(Text=rep_2, Find=";", Replace=",", RecursiveReplace=False)
rep_4 = ReplaceText(Text=rep_3, Find="}", Replace=",", RecursiveReplace=False)
R = ClusterOutput(rep_4)

# ==== cluster RoundPoint
data = ClusterInput()
data_2 = ClusterInput()
data_3 = Data(data)
pdecon = Deconstruct(Point=data_3)  # -> XComponent, YComponent, ZComponent
data_4 = Data(data_2)
roundd = RoundToDecimalPlace(NumberX=pdecon.XComponent, DecimalPlace=data_4, RoundType=0)  # -> Rounded, Difference
roundd_2 = RoundToDecimalPlace(NumberX=pdecon.YComponent, DecimalPlace=data_4, RoundType=0)  # -> Rounded, Difference
roundd_3 = RoundToDecimalPlace(NumberX=pdecon.ZComponent, DecimalPlace=data_4, RoundType=0)  # -> Rounded, Difference
pt = ConstructPoint(XCoordinate=roundd.Rounded, YCoordinate=roundd_2.Rounded, ZCoordinate=roundd_3.Rounded)
pt_2 = ClusterOutput(pt)

# ==== cluster ShiftPaths: Shift -1 in all data tree paths
data = ClusterInput()  # Data to modify
data_2 = Data(simplify(data))
path_mapper = PathMapper(
    data_2,
    source=["{A}", "{A;B}", "{A;B;C}", "{A;B;C;D}", "{A;B;C;D;E}", "{A;B;C;D;E;F}", "{A;B;C;D;E;F;G}", "{A;B;C;D;E;F;G;H}", "{A;B;C;D;E;F;G;H;I}", "{A;B;C;D;E;F;G;H;I;K}"],
    target=["{0}", "{A}", "{A;B}", "{A;B;C}", "{A;B;C;D}", "{A;B;C;D;E}", "{A;B;C;D;E;F}", "{A;B;C;D;E;F;G}", "{A;B;C;D;E;F;G;H}", "{A;B;C;D;E;F;G;H;I}"])
data_3 = Data(path_mapper)
data_4 = ClusterOutput(data_3)  # Shifted data
