# Grasshopper definition grid_007.gh (Grasshopper 1.0.7)
# plug-ins: Pancake, Pufferfish, Human

panel = Panel("C:\Users\Matthew\OneDrive\My Documents\home\projects\skies-denver\Masks & Models\Masks _ Models\2D Masks\_USE THIS MASK_\mask.svg")
pcimportsvg = ImportSVG(File=panel, LastSaveLocalization="neutral,N")
rotate = Rotate(Geometry=pcimportsvg, Angle=1.570796327, Plane=PlaneXY(0, 0, 0))  # -> Geometry, Transform
brec = BoundingRectangle(Geometry=rotate.Geometry, Plane=PlaneXY(0, 0, 0), Axis=0, Slide=0, Union=True)  # -> Bounding, DimensionX, DimensionY
explode = Explode(Curve=brec.Bounding, Recursive=True)  # -> Segments, Vertices
area = Area(Geometry=rotate.Geometry)  # -> Area, Centroid
item = ListItem(List=explode.Segments, Index=0, Wrap=True)
sort = SortList(Keys=area.Area, ValuesA=rotate.Geometry)  # -> Keys, reverse(ValuesA)
split = SplitList(List=sort.ValuesA, Index="1")  # -> ListA, ListB
item_2 = ListItem(List=rotate.Transform, Index=0, Wrap=True)
line = Line(Line((0.55, -268.58952, 0), (3438.55, -268.58952, 0)))
boundary = BoundarySurfaces(Edges=split.ListB)
transform = Transform(Geometry=line, Transform=item_2)
disc = Discontinuity(Curve=boundary, Level="3")  # -> Points, Parameters
pull = PullPoint(Point=flatten(disc.Points), Geometry=item, ClosestOnly=True)  # -> ClosestPoint, Distance
pull_2 = PullPoint(Point=flatten(disc.Points), Geometry=transform, ClosestOnly=True)  # -> ClosestPoint, Distance
smaller = SmallerThan(FirstNumber=pull_2.Distance, SecondNumber="10")  # -> SmallerThan, OrEqualTo
smaller_2 = SmallerThan(FirstNumber=pull.Distance, SecondNumber="0.03")  # -> SmallerThan, OrEqualTo
dispatch = Dispatch(List=flatten(disc.Points), DispatchPattern=smaller_2.SmallerThan)  # -> ListA, ListB
dispatch_2 = Dispatch(List=flatten(disc.Points), DispatchPattern=smaller.SmallerThan)  # -> ListA, ListB
end = EndPoints(Curve=item)  # -> Start, End
end_2 = EndPoints(Curve=transform)  # -> Start, End
pt = Point(dispatch.ListA)
merge = Merge(Data1=end.Start, Data2=end.End)
pt_2 = Point(dispatch_2.ListA)
lng = ListLength(List=pt)
merge_2 = Merge(Data1=end_2.Start, Data2=end_2.End)
lng_2 = ListLength(List=pt_2)
boundary_2 = BoundarySurfaces(Edges=split.ListA)
ins = InsertItems(List=pt_2, Item=merge_2, Indices=flatten(["0", lng_2]), Wrap=True)
ins_2 = InsertItems(List=pt, Item=merge, Indices=flatten(["0", lng]), Wrap=True)
cullpt = CullDuplicates(Points=ins, Tolerance=Slider(4, range=0..10), CullMode=3)  # -> Points, Indices, Valence
srf = Surface(reparameterize(boundary_2))
srf_cp = SurfaceClosestPoint(Point=cullpt.Points, Surface=srf)  # -> Point, UVPoint, Distance
pdecon = Deconstruct(Point=srf_cp.UVPoint)  # -> XComponent, YComponent, ZComponent
number_slider = Slider(10, range=0..100)
number_slider_2 = Slider(6, range=0..100)
srf_cp_2 = SurfaceClosestPoint(Point=ins_2, Surface=srf)  # -> Point, UVPoint, Distance
pdecon_2 = Deconstruct(Point=srf_cp_2.UVPoint)  # -> XComponent, YComponent, ZComponent
sort_2 = SortList(Keys=pdecon_2.YComponent)  # -> Keys, ValuesA
sort_3 = SortList(Keys=pdecon.XComponent)  # -> Keys, ValuesA
shift = ShiftList(List=sort_2.Keys, Shift=1, Wrap=False)
srf_2 = Surface(reparameterize(boundary_2))
multiplication = Multiplication(A=number_slider, B=number_slider_2)
shift_2 = ShiftList(List=sort_3.Keys, Shift=1, Wrap=False)
lng_3 = ListLength(List=sort_2.Keys)  # -> expr("x-1", Length)
divide = DivideDomain²(Domain=srf, UCount=number_slider, VCount=number_slider_2)
concat = Concatenate(FragmentA=sort_2.Keys, FragmentB=" To ", FragmentC=shift)
panel_2 = Panel(multiplication)
lng_4 = ListLength(List=sort_3.Keys)  # -> expr("x-1", Length)
concat_2 = Concatenate(FragmentA=sort_3.Keys, FragmentB=" To ", FragmentC=shift_2)
cull_i = CullIndex(List=concat, Indices=lng_3, Wrap=True)
cull_i_2 = CullIndex(List=concat_2, Indices=lng_4, Wrap=True)
dom² = ConstructDomain²(DomainU=graft(cull_i_2), DomainV=cull_i)
subsrf = Isotrim(Surface=srf, Domain=divide)
edges = BrepEdges(Brep=subsrf)  # -> Naked, Interior, NonManifold
subsrf_2 = Isotrim(Surface=srf, Domain=dom²)  # -> flatten(Surface)
number_slider_3 = Slider(3, range=1..11)
divide_2 = DivideDomain²(Domain=srf_2, UCount=Slider(7, range=0..10), VCount=Slider(5, range=0..10))
divide_3 = DivideDomain²(Domain=srf_2, UCount=Slider(3, range=0..10), VCount=Slider(3, range=0..10))
subsrf_3 = Isotrim(Surface=srf_2, Domain=divide_2)
edges_2 = BrepEdges(Brep=subsrf_3)  # -> Naked, Interior, NonManifold
subsrf_4 = Isotrim(Surface=srf_2, Domain=divide_3)
edges_3 = BrepEdges(Brep=subsrf_4)  # -> Naked, Interior, NonManifold
join = JoinCurves(Curves=edges_2.Naked, Preserve=False)
flatten = FlattenTree(Tree=subsrf_2, Path="{0}")
area_2 = Area(Geometry=flatten)  # -> Area, Centroid
area_3 = Area(Geometry=flatten)  # -> Area, Centroid
join_2 = JoinCurves(Curves=edges_3.Naked, Preserve=False)
incurve = PointInCurve(Point=area_2.Centroid, Curve=join)  # -> Relationship, Point
previewlw = CustomPreviewLineweights(Geometry=join_2, Shader=ColourSwatch(SwatchColor=RGB(255, 8, 8)), Thickness=Slider(5, range=0..10), Absolute=False)
incurve_2 = PointInCurve(Point=area_3.Centroid, Curve=join_2)  # -> Relationship, Point
pt_3 = Point(area_3.Centroid)
equals = Equality(FirstNumber="2", SecondNumber=incurve.Relationship)  # -> Equality, Inequality
lng_5 = ListLength(List=area_2.Centroid)
lng_6 = ListLength(List=area_3.Centroid)
equals_2 = Equality(FirstNumber="2", SecondNumber=incurve_2.Relationship)  # -> Equality, Inequality
series = Series(Start=0, Step=1, Count=lng_5)
series_2 = Series(Start=0, Step=1, Count=lng_6)
dispatch_3 = Dispatch(List=series, DispatchPattern=equals.Equality)  # -> ListA, ListB
dispatch_4 = Dispatch(List=series_2, DispatchPattern=equals_2.Equality)  # -> ListA, ListB
dir = DirectoryContents(FolderPath="C:\cWeb\projects\skies-media\public\images\skies", Filter="*", IncludeSubfolders=False)  # -> FilePaths, FileNames
repeat = RepeatData(Data=dir.FileNames, Length="140")
concat_3 = Concatenate(FragmentA="\"", FragmentB=repeat, FragmentC="\",")
smesh = SimpleMesh(Brep=flatten)
item_3 = ListItem(List=smesh, Index=dispatch_3.ListA, Wrap=True)
tstat = TreeStatistics(Tree=item_3)  # -> Paths, Length, Count
range = Range(Domain=Domain(0, 1), Steps=expr("x-1", tstat.Count))
item_4 = ListItem(List=smesh, Index=dispatch_4.ListA, Wrap=True)
tstat_2 = TreeStatistics(Tree=item_4)  # -> Paths, Length, Count
range_2 = Range(Domain="0.2 to 0.8", Steps=expr("x-1", tstat_2.Count))
hsv = ColourHSV(Alpha=1, Hue=graft(range), Saturation=1, Value=1)
hsv_2 = ColourHSV(Alpha=1, Hue=graft(range_2), Saturation=1, Value=1)
lng_7 = ListLength(List=smesh)
series_3 = Series(Start=0, Step=1, Count=lng_7)
series_4 = Series(Start=0, Step=1, Count=lng_7)
item_5 = ListItem(List=series_3, Index=dispatch_3.ListA, Wrap=True)
brec_2 = BoundingRectangle(Geometry=item_3, Plane=PlaneXY(0, 0, 0), Axis=0, Slide=0, Union=True)  # -> Bounding, DimensionX, DimensionY
preview = CustomPreview(Geometry=item_3, Material=hsv)
brec_3 = BoundingRectangle(Geometry=item_4, Plane=PlaneXY(0, 0, 0), Axis=0, Slide=0, Union=True)  # -> Bounding, DimensionX, DimensionY
item_6 = ListItem(List=series_4, Index=dispatch_4.ListA, Wrap=True)
preview_2 = CustomPreview(Geometry=item_4, Material=hsv_2)
boundary_3 = BoundarySurfaces(Edges=brec_2.Bounding)
boundary_4 = BoundarySurfaces(Edges=brec_3.Bounding)
surfacemap = SurfaceMapping(Mesh=item_3, Surface=boundary_3)  # -> flatten(MappedMesh)
panel_3 = Panel(concat_3)
brec_4 = BoundingRectangle(Geometry=flatten(smesh), Plane=PlaneXY(0, 0, 0), Axis=0, Slide=0, Union=True)  # -> Bounding, DimensionX, DimensionY
boundary_5 = BoundarySurfaces(Edges=brec_4.Bounding)
surfacemap_2 = SurfaceMapping(Mesh=smesh, Surface=boundary_5)  # -> flatten(MappedMesh)
surfacemap_3 = SurfaceMapping(Mesh=item_4, Surface=boundary_4)  # -> flatten(MappedMesh)
lng_8 = ListLength(List=item_6)
sort_4 = SortList(Keys=flatten(item_6), ValuesA=surfacemap_3)  # -> Keys, ValuesA
mesh = Mesh(smesh)
brec_5 = BoundingRectangle(Geometry=flatten(mesh), Plane=PlaneXY(0, 0, 0), Axis=0, Slide=0, Union=True)  # -> Bounding, DimensionX, DimensionY
panel_4 = Panel(lng_8)
lng_9 = ListLength(List=item_3)
division = Division(A="1", B=brec_5.DimensionY)
area_4 = Area(Geometry=brec_5.Bounding)  # -> Area, Centroid
de_code_mesh = DeCodeMesh(m=surfacemap_2)  # -> F, V, C, N, UVs; inputs m: Mesh
# ---------- de_code_mesh: Python ----------
"""Extract Mesh UV coordinates
    Inputs:
        m: Mesh to extract UV coordinates from
    Output:
        F: List of faces
        V: List of vertices
        C: List of vertex colors, if they exist
        N: List of face normals, if they exist
        UVs: List of texture coordinates (UVs), if they exist"""

__author__ = "Nathan"
__version__ = "2018.07.20"

import rhinoscriptsyntax as rs

if not m==None:
    F = m.Faces
    V = m.Vertices
    N = m.FaceNormals
    C = m.VertexColors
    UVs = m.TextureCoordinates
# ---------- end de_code_mesh ----------
de_code_mesh_2 = DeCodeMesh(m=sort_4.ValuesA)  # -> F, V, C, N, UVs; inputs m: Mesh; same code as de_code_mesh
rev = Reverse(Vector=area_4.Centroid)
move = Move(Geometry=mesh, Motion=rev)  # -> Geometry, Transform
round_point = RoundPoint(data=de_code_mesh.UVs, data_2="3")
scale = Scale(Geometry=move.Geometry, Center=Point(0, 0, 0), Factor=division)  # -> Geometry, Transform
tri = Triangulate(Mesh=graft(scale.Geometry))  # -> Mesh, Count
mjoin = MeshJoin(Meshes=tri.Mesh)  # -> flatten(Mesh)
tstat_3 = TreeStatistics(Tree=panel_4)  # -> Paths, Length, Count
demesh = DeconstructMesh(Mesh=mjoin)  # -> Vertices, simplify(Faces), Colours, Normals
round_point_2 = RoundPoint(data=de_code_mesh_2.UVs, data_2="3")
pdecon_3 = Deconstruct(Point=round_point)  # -> XComponent, YComponent, ZComponent
panel_5 = Panel(lng_9)
pdecon_4 = Deconstruct(Point=round_point_2)  # -> XComponent, YComponent, ZComponent
series_5 = Series(Start=0, Step=1, Count=tstat_3.Count)
concat_4 = Concatenate(FragmentA=pdecon_3.YComponent, FragmentD=",", FragmentB=pdecon_3.XComponent, FragmentE=",")
repeat_2 = RepeatData(Data=graft(series_5), Length=panel_4)
facetoarr = FaceToArr(T=demesh.Faces)
pdecon_5 = Deconstruct(Point=demesh.Vertices)  # -> XComponent, YComponent, ZComponent
concat_5 = Concatenate(FragmentA=pdecon_4.YComponent, FragmentD=",", FragmentB=pdecon_4.XComponent, FragmentE=",")
join_3 = TextJoin(Text=concat_4)
tstat_4 = TreeStatistics(Tree=panel_5)  # -> Paths, Length, Count
concat_6 = Concatenate(FragmentA=repeat_2, FragmentB=",")
sort_5 = SortList(Keys=flatten(item_6), ValuesA=flatten(concat_6))  # -> Keys, ValuesA
join_4 = TextJoin(Text=concat_5)
join_5 = TextJoin(Text=facetoarr)
concat_7 = Concatenate(
    FragmentA=pdecon_5.XComponent,
    FragmentD=",",
    FragmentB=pdecon_5.YComponent,
    FragmentE=",",
    FragmentC=pdecon_5.ZComponent,
    FragmentF=",")
join_6 = TextJoin(Text=flatten(sort_5.ValuesA))
series_6 = Series(Start=0, Step=1, Count=tstat_4.Count)
join_7 = TextJoin(Text=concat_7)
repeat_3 = RepeatData(Data=graft(series_6), Length=panel_5)
concat_8 = Concatenate(FragmentA="[", FragmentB=join_5, FragmentC="]", FragmentD=",")
concat_9 = Concatenate(FragmentA="[", FragmentB=join_3, FragmentC="]", FragmentD=",")
concat_10 = Concatenate(FragmentA="[", FragmentB=join_4, FragmentC="]", FragmentD=",")
concat_11 = Concatenate(FragmentA="[", FragmentB=join_7, FragmentC="]", FragmentD=",")
concat_12 = Concatenate(FragmentA=repeat_3, FragmentB=",")
sort_6 = SortList(Keys=flatten(item_5), ValuesA=surfacemap, ValuesB=flatten(concat_12))  # -> Keys, ValuesA, ValuesB
de_code_mesh_3 = DeCodeMesh(m=sort_6.ValuesA)  # -> F, V, C, N, UVs; inputs m: Mesh; same code as de_code_mesh
round_point_3 = RoundPoint(data=de_code_mesh_3.UVs, data_2="3")
pdecon_6 = Deconstruct(Point=round_point_3)  # -> XComponent, YComponent, ZComponent
concat_13 = Concatenate(FragmentA=pdecon_6.YComponent, FragmentD=",", FragmentB=pdecon_6.XComponent, FragmentE=",")
join_8 = TextJoin(Text=concat_13)
concat_14 = Concatenate(FragmentA="[", FragmentB=join_8, FragmentC="]", FragmentD=",")
panel_6 = Panel(concat_12)
join_9 = TextJoin(Text=flatten(sort_6.ValuesB))
concat_15 = Concatenate(
    FragmentE="{",
    FragmentA="ids: ",
    FragmentB=concat_8,
    FragmentD="position:",
    FragmentC=concat_11,
    FragmentG="uv_0:",
    FragmentH=concat_10,
    FragmentK="uv_1:",
    FragmentL=concat_14,
    FragmentI="uv_fill:",
    FragmentJ=concat_9,
    FragmentF="},")
join_10 = TextJoin(Text=flatten(concat_15))
panel_7 = Panel("C:\cWeb\projects\skies-media\src\components-canvas\MultiCell\multi-cell-data.ts")
concat_16 = Concatenate(FragmentA="export const cell_data = [", FragmentC=join_6, FragmentB="]")
panel_8 = Panel("C:\cWeb\projects\skies-media\src\data\meshData-multi-cell.ts")
concat_17 = Concatenate(FragmentA="export const meshDataCells = [", FragmentC=join_10, FragmentB="]")
concat_18 = Concatenate(FragmentA="export const cell_data_1 = [", FragmentC=join_9, FragmentB="]")
concat_19 = Concatenate(FragmentA=concat_16, FragmentC=concat_18)
join_11 = TextJoin(Text=concat_19)
join_12 = TextJoin(Text=concat_17)
wrtietext = WrtieText(filePath=panel_8, data=join_12, activate=Toggle(True))  # -> out, A; inputs data: list
# ---------- wrtietext: VB ----------
    If activate Then

      Dim i As Integer
      Dim aryText(4) As String

      aryText(0) = "Mary WriteLine"
      aryText(1) = "Had"
      aryText(2) = "Another"
      aryText(3) = "Little"
      aryText(4) = "One"

      ' the data is appended to the file. If file doesnt exist, a new file is created
      Dim objWriter As New System.IO.StreamWriter(filePath, append)

      For i = 0 To data.Count - 1
        objWriter.WriteLine(data(i))
      Next

      objWriter.Close()

    End If

    If clearFile Then
      Dim objWriter As New System.IO.StreamWriter(filePath, False)
      objWriter.Close()
    End If
# ---------- end wrtietext ----------
wrtietext_2 = WrtieText(filePath=panel_7, data=join_11, activate=Toggle(True))  # -> out, A; inputs data: list; same code as wrtietext

# ==== cluster FaceToArr
T = ClusterInput()
rep = ReplaceText(Text=T, Find="T", RecursiveReplace=False)
rep_2 = ReplaceText(Text=rep, Find="{", RecursiveReplace=False)
rep_3 = ReplaceText(Text=rep_2, Find=";", Replace=",", RecursiveReplace=False)
rep_4 = ReplaceText(Text=rep_3, Find="}", Replace=",", RecursiveReplace=False)
R = ClusterOutput(rep_4)

# ==== cluster RoundPoint
data = ClusterInput()
data_2 = ClusterInput()
data_3 = Data(data)
pdecon = Deconstruct(Point=data_3)  # -> XComponent, YComponent, ZComponent
data_4 = Data(data_2)
roundd = RoundToDecimalPlace(NumberX=pdecon.XComponent, DecimalPlace=data_4, RoundType=0)  # -> Rounded, Difference
roundd_2 = RoundToDecimalPlace(NumberX=pdecon.YComponent, DecimalPlace=data_4, RoundType=0)  # -> Rounded, Difference
roundd_3 = RoundToDecimalPlace(NumberX=pdecon.ZComponent, DecimalPlace=data_4, RoundType=0)  # -> Rounded, Difference
pt = ConstructPoint(XCoordinate=roundd.Rounded, YCoordinate=roundd_2.Rounded, ZCoordinate=roundd_3.Rounded)
pt_2 = ClusterOutput(pt)
