# Grasshopper definition process-colours-denver-002.gh (Grasshopper 1.0.7)
# plug-ins: Pufferfish, Human, Anemone, Owl.GH, Pancake, Heteroptera

c_script = CSharpScript()  # -> fullPath
# ---------- c_script: C# usings ----------
using System.IO;
using System.Linq;
using System.Data;
using System.Drawing;
using System.Reflection;
using System.Windows.Forms;
using System.Xml;
using System.Xml.Linq;
using System.Runtime.InteropServices;

using Rhino.DocObjects;
using Rhino.Collections;
using GH_IO;
using GH_IO.Serialization;
# ---------- c_script: C# ----------
    string path = this.GrasshopperDocument.FilePath;
    string directory = Path.GetDirectoryName(path);
    fullPath = directory + '\\' + name;
# ---------- end c_script ----------

# ---- group: sampling detail (rough processing time)
# low: <30s
# medium: 2-10m
# high: 15m +
list = ValueList({"Low": 0, "Med": 1, "High": 2}, selected="Med")

# ----
geo = Geometry([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])
split = TextSplit(Text=c_script, Separators="$")
item = ListItem(List=split, Index=0, Wrap=True)  # -> Item, Item1
project_root = Panel(item.Item)
concat = Concatenate(FragmentA=item.Item, FragmentB="$_process-colours\obj\build.obj")
concat_2 = Concatenate(FragmentA=item.Item, FragmentB="$_process-colours\sky-photos\")
concat_3 = Concatenate(FragmentA=item.Item, FragmentB="$_process-colours\output\")
panel = Panel("Sky_02")
number_slider = Slider(3500, range=0..10000)
boundary = BoundarySurfaces(Edges=geo)  # -> reparameterize(Surfaces)
dir = DirectoryContents(FolderPath=concat_2, Filter="*", IncludeSubfolders=Toggle(True))  # -> FilePaths, FileNames
filter = StreamFilter(Gate=list, Stream0="0.7", Stream1="1.5", Stream2="2.2")
filter_2 = StreamFilter(Gate=list, Stream0="0.5", Stream1="1.0", Stream2="1.5")

# ---- group: GRID
dim = Dimensions(Surface=boundary)  # -> UDimension, VDimension
multiplication = Multiplication(A=dim.UDimension, B=filter_2)
multiplication_2 = Multiplication(A=dim.VDimension, B=filter)
range = Range(Domain=Domain(0, 1), Steps=multiplication_2)
range_2 = Range(Domain=Domain(0, 1), Steps=multiplication)
paramsubdivsrf = ParameterSubdivideSurface(Surface=reparameterize(graft(boundary)), ParametersU=range_2, ParametersV=range)  # disabled

# ----
jitter = Jitter(List=dir.FilePaths, Jitter=1, Seed=2)  # -> Values, Indices
lng = ListLength(List=jitter.Values)
filter_3 = StreamFilter(Gate=list, Stream0="222", Stream1="500", Stream2=lng)
srf = Surface(paramsubdivsrf)  # disabled
number_slider_2 = Slider(5, range=0..10)

number_slider_3 = Slider(26, range=0..100)

series = Series(Start=0, Step=1, Count=Slider(1200, range=0..10000))
item_2 = ListItem(List=jitter.Values, Index=series, Wrap=True)
item_3 = ListItem(List=dir.FileNames, Index=series, Wrap=True)
txt = Text(item_3)
img = ImportImage(File=item_2, XSamples="20", YSamples="20")
srf_2 = Surface(paramsubdivsrf)  # disabled
null = NullItem(Item=img)  # -> NullFlags, InvalidFlags, Description
cull = CullPattern(List=item_2, CullPattern=invert(null.NullFlags))
cull_2 = CullPattern(List=txt, CullPattern=invert(null.NullFlags))
cull_3 = CullPattern(List=img, CullPattern=invert(null.NullFlags))
mesh = Mesh(cull_3)

# ---- group: K-Means Cluster
demesh = DeconstructMesh(Mesh=cull_3)  # -> Vertices, Faces, Colours, Normals
featurets = FeatureTensorSet(Feature0=demesh.Colours)
kmeans = KMeansClustering(Data=featurets, Clusters=number_slider_2, Iterations=1, Seed=123)  # -> Clusters, Indices
detset = DeconstructTensorSet(TensorSet=kmeans.Clusters)
detensor = DeconstructTensor(Tensor=detset)  # -> simplify(Values)
pshift = ShiftPaths(Data=detensor, Offset=-1)
lng_2 = ListLength(List=pshift)
tstat = TreeStatistics(Tree=pshift)  # -> Paths, Length, Count
pshift_2 = ShiftPaths(Data=lng_2, Offset=-1)
partition = PartitionList(List=tstat.Paths, Size=number_slider_2)
sort = SortList(Keys=pshift_2, ValuesA=partition)  # -> Keys, ValuesA
item_4 = ListItem(List=sort.ValuesA, Index="-1", Wrap=True)
branch = TreeBranch(Tree=pshift, Path=item_4, MaintainPaths=True)
partition_2 = PartitionList(List=branch, Size="3")
item_5 = ListItem(List=partition_2, Index=0, Wrap=True)  # -> Item, Item1, Item2
pshift_3 = ShiftPaths(Data=item_5.Item, Offset=-1)
pshift_4 = ShiftPaths(Data=item_5.Item1, Offset=-1)
pshift_5 = ShiftPaths(Data=item_5.Item2, Offset=-1)
avr = Average(Input=pshift_3)
avr_2 = Average(Input=pshift_4)
avr_3 = Average(Input=pshift_5)
round = Round(Number=avr)  # -> Nearest, Floor, Ceiling
round_2 = Round(Number=avr_2)  # -> Nearest, Floor, Ceiling
round_3 = Round(Number=avr_3)  # -> Nearest, Floor, Ceiling
merge = Merge(Data1=round.Nearest, Data2=round_2.Nearest, Data3=round_3.Nearest)
rgb = ColourRGB(Alpha=255, Red=round.Nearest, Green=round_2.Nearest, Blue=round_3.Nearest)

# ----
repeat = RepeatData(Data="0", Length=Slider(50, range=0..100))
ins = InsertItems(List=repeat, Item="1", Indices=Slider(50, range=0..100), Wrap=True)
cull_4 = CullPattern(List=demesh.Colours, CullPattern=ins)
number_slider_4 = Slider(2, range=0..10)
featurets_2 = FeatureTensorSet(Feature0=flatten(cull_4))
kmeans_2 = KMeansClustering(Data=featurets_2, Clusters=number_slider_3, Iterations=1, Seed=123)  # -> Clusters, Indices
detset_2 = DeconstructTensorSet(TensorSet=kmeans_2.Clusters)
detensor_2 = DeconstructTensor(Tensor=detset_2)  # -> simplify(Values)
item_6 = ListItem(List=flatten(cull_4), Index=kmeans_2.Indices, Wrap=True)
item_7 = ListItem(List=detensor_2, Index=0, Wrap=True)  # -> Item, Item1, Item2
rgb_2 = ColourRGB(Alpha=255, Red=item_7.Item, Green=item_7.Item1, Blue=item_7.Item2)
pshift_6 = ShiftPaths(Data=rgb_2, Offset=-1)
preview = CustomPreview(Geometry=item_6, Material=pshift_6)
number_slider_5 = Slider(0, range=0..10)
tstat_2 = TreeStatistics(Tree=item_6)  # -> Paths, Length, Count
tstat_3 = TreeStatistics(Tree=pshift_6)  # -> Paths, Length, Count
item_8 = ListItem(List=tstat_3.Paths, Index=number_slider_5, Wrap=True)
item_9 = ListItem(List=tstat_2.Paths, Index=number_slider_5, Wrap=True)
branch_2 = TreeBranch(Tree=item_6, Path=item_9, MaintainPaths=True)
branch_3 = TreeBranch(Tree=pshift_6, Path=item_8, MaintainPaths=True)
preview_2 = CustomPreview(Geometry=branch_2, Material=branch_3)

txt_2 = Text(cull)
txt_3 = Text(cull_2)
split_2 = TextSplit(Text=cull_4, Separators=",")
num = Number(split_2)
python = GhPythonScript(rgb_values=num)  # -> out, hsv_values; inputs rgb_values: list
# ---------- python: Python ----------
import colorsys

hsv_values = []

# Group the input list into sets of three to form RGB tuples
rgb_tuples = zip(*[iter(rgb_values)] * 3)

# Loop through each RGB tuple
for rgb in rgb_tuples:
    # Normalize the RGB values to the range [0, 1]
    r, g, b = [x / 255.0 for x in rgb]
    
    # Convert RGB to HSV
    h, s, v = colorsys.rgb_to_hsv(r, g, b)
    
    # Append the HSV values to the output list
    hsv_values.append((int(h * 360), int(s * 100), int(v * 100)))

a = hsv_values
# ---------- end python ----------
cull_5 = CullPattern(List=demesh.Vertices, CullPattern=ins)
srf_3 = Surface(boundary)

# ---- group: string-list
cluster = Cluster(T=python.hsv_values)

# ----
mesh_2 = MeshBrep(
    Brep=srf_3,
    Settings={GridMaxCount=0, GridMinCount=16, JaggedSeams=False, MaxEdgeLength=0, MinEdgeLength=0.0001, MinTolerance=0, Refine=True, RefineAngle=0, RelativeTolerance=0.65, SimplePlanes=True, Tolerance=0})
X = UnitX(Factor=Slider(88, range=0..100))
area = Area(Geometry=srf_2)  # -> Area, Centroid; disabled
dir_2 = DirectoryContents(FolderPath="C:\Users\Jimi Hendrix\Documents\proj\skies\sample\snd", Filter="*", IncludeSubfolders=False)  # -> FilePaths, FileNames
surfacemap = SurfaceMapping(Mesh=mesh_2, Surface=srf_3)
srf_cp = SurfaceClosestPoint(Point=area.Centroid, Surface=graft(boundary))  # -> Point, UVPoint, Distance; disabled
item_10 = ListItem(List=cluster, Index=0, Wrap=True)
item_11 = ListItem(List=num, Index=0, Wrap=True)  # -> Item, Item1, Item2
move = Move(Geometry=surfacemap, Motion=X)  # -> Geometry, Transform
pshift_7 = ShiftPaths(Data=item_10, Offset=-1)
pt = Point(srf_cp.UVPoint)  # disabled
previewmat = CustomPreviewMaterials(Geometry=move.Geometry, DiffuseColor=RGB(255, 255, 255), DiffuseBitmap=dir_2.FilePaths)
pt_2 = ConstructPoint(XCoordinate=item_11.Item, YCoordinate=item_11.Item1, ZCoordinate=item_11.Item2)
bang = ExplodeTree(Data=pt)  # -> Branch0, Branch1, Branch2, Branch3; disabled
num_2 = Number(pshift_7)
pshift_8 = ShiftPaths(Data=pt_2, Offset=-1)
brec = BoundingRectangle(Geometry=graft(cull_3), Plane=PlaneXY(0, 0, 0), Axis=0, Slide=0, Union=True)  # -> flatten(Bounding), DimensionX, DimensionY

# ---- group: average colour (slow)
panel_2 = Panel(",")  # disabled
split_3 = TextSplit(Text=demesh.Colours, Separators=panel_2)  # disabled
item_12 = ListItem(List=split_3, Index=0, Wrap=True)  # -> Item, Item1, Item2; disabled
pshift_9 = ShiftPaths(Data=item_12.Item2, Offset=-1)  # disabled
pshift_10 = ShiftPaths(Data=item_12.Item, Offset=-1)  # disabled
pshift_11 = ShiftPaths(Data=item_12.Item1, Offset=-1)  # disabled
int = Integer(pshift_10)  # disabled
int_2 = Integer(pshift_11)  # disabled
int_3 = Integer(pshift_9)  # disabled
avr_4 = Average(Input=int)  # disabled
avr_5 = Average(Input=int_2)  # disabled
avr_6 = Average(Input=int_3)  # disabled
merge_2 = Merge(Data1=avr_4, Data2=avr_5, Data3=avr_6)  # disabled

# ----
avr_7 = Average(Input=num_2)  # -> flatten(ArithmeticMean)
featurets_3 = FeatureTensorSet(Feature0=flatten(avr_7))
kmeans_3 = KMeansClustering(Data=featurets_3, Clusters=number_slider_3, Iterations=1, Seed=123)  # -> Clusters, Indices
item_13 = ListItem(List=avr_7, Index=kmeans_3.Indices, Wrap=True)
item_14 = ListItem(List=txt_3, Index=kmeans_3.Indices, Wrap=True)
avr_8 = Average(Input=pshift_8)
item_15 = ListItem(List=txt_2, Index=kmeans_3.Indices, Wrap=True)
image = ImageSampler(bang.Branch0, Filter="Colour", Interpolate=False, Umax=1, Umin=0, Vmax=1, Vmin=0, Wrap=1)  # disabled
image_2 = ImageSampler(bang.Branch1, Filter="Colour", Interpolate=False, Umax=1, Umin=0, Vmax=1, Vmin=0, Wrap=1)  # disabled
image_3 = ImageSampler(bang.Branch2, Filter="Colour", Interpolate=False, Umax=1, Umin=0, Vmax=1, Vmin=0, Wrap=1)  # disabled
image_4 = ImageSampler(bang.Branch3, Filter="Colour", Interpolate=False, Umax=1, Umin=0, Vmax=1, Vmin=0, Wrap=1)  # disabled
clean = CleanTree(RemoveNulls=True, RemoveInvalid=True, RemoveEmpty=True, Tree=avr_8)
clean_2 = CleanTree(RemoveNulls=True, RemoveInvalid=True, RemoveEmpty=True, Tree=item_14)
item_16 = ListItem(List=brec.Bounding, Index=kmeans_3.Indices, Wrap=True)
clean_3 = CleanTree(RemoveNulls=True, RemoveInvalid=True, RemoveEmpty=True, Tree=item_13)
clean_4 = CleanTree(RemoveNulls=True, RemoveInvalid=True, RemoveEmpty=True, Tree=item_15)
pdecon = Deconstruct(Point=clean)  # -> XComponent, YComponent, ZComponent
clean_5 = CleanTree(RemoveNulls=True, RemoveInvalid=True, RemoveEmpty=True, Tree=item_16)
rgb_3 = ColourRGB(Alpha=255, Red=pdecon.XComponent, Green=pdecon.YComponent, Blue=pdecon.ZComponent)  # -> flatten(Colour)
item_17 = ListItem(List=rgb_3, Index=kmeans_3.Indices, Wrap=True)
clean_6 = CleanTree(RemoveNulls=True, RemoveInvalid=True, RemoveEmpty=True, Tree=item_17)
entwine = Entwine(Branch00=image, Branch01=image_2, Branch02=image_3, Branch03=image_4, FlattenInputs=True)  # disabled
num_3 = Number(clean_3)
series_2 = Series(Start=0, Step=Slider(3, range=0..10), Count=number_slider_3)
avr_9 = Average(Input=num_3)  # -> flatten(ArithmeticMean)
X_2 = UnitX(Factor=series_2)
tstat_4 = TreeStatistics(Tree=simplify(clean_6))  # -> Paths, Length, Count
sort_2 = SortList(Keys=avr_9, ValuesA=tstat_4.Paths)  # -> Keys, ValuesA
move_2 = Move(Geometry=item_6, Motion=graft(X_2))  # -> Geometry, Transform
branch_4 = TreeBranch(Tree=simplify(clean_6), Path=sort_2.ValuesA, MaintainPaths=False)
branch_5 = TreeBranch(Tree=simplify(clean_6), Path=sort_2.ValuesA, MaintainPaths=False)
branch_6 = TreeBranch(Tree=simplify(clean_2), Path=sort_2.ValuesA, MaintainPaths=False)
branch_7 = TreeBranch(Tree=simplify(clean_4), Path=sort_2.ValuesA, MaintainPaths=False)
branch_8 = TreeBranch(Tree=simplify(clean_5), Path=sort_2.ValuesA, MaintainPaths=False)
multiplication_3 = Multiplication(A=Slider(8, range=0..10), B=Slider(16, range=0..100))
preview_3 = CustomPreview(Geometry=move_2.Geometry, Material=pshift_6)
panel_3 = Panel("""5
6
13
22
27
55""")
lng_3 = ListLength(List=branch_7)
data = Data(branch_4)
panel_4 = Panel(multiplication_3)
area_2 = Area(Geometry=branch_8)  # -> Area, Centroid

# ---- group: Screen Data
col = Colour(flatten(entwine))  # disabled
lng_4 = ListLength(List=entwine)  # disabled
pt_3 = Point(area.Centroid)  # disabled
srf_4 = Surface(srf_2)  # disabled

# ---- group: Image Data
col_2 = Colour(flatten(rgb))
txt_4 = Text(cull)

# ----
num_4 = Number(Slider(6, range=0..10))

# ---- group: Remove alpha values
split_4 = TextSplit(Text=col, Separators="(")  # disabled
item_18 = ListItem(List=split_4, Index=0, Wrap=True)  # -> flatten(Item); disabled

# ----
series_3 = Series(Start=0, Step="3.5", Count=lng_3)
series_4 = Series(Start=0, Step=Slider(3, range=0..10), Count=tstat_4.Count)
lng_5 = ListLength(List=data)
num_5 = Number(flatten(lng_5))
pt_4 = ConstructPoint(XCoordinate=series_4, YCoordinate=0, ZCoordinate=0)
python_2 = GhPythonScript(numbers=num_5, limit=num_4)  # -> out, factors; inputs numbers: list
# ---------- python_2: Python ----------
def closest_factors(nums, limit):
    factors = []
    for num in nums:
        best_diff = float('inf')
        best_factors = ()
        i = 0
        while True:
            n = num - i
            if n > 0:
                f = find_factors(n)
                diff = abs(f[0] - f[1])
                if diff <= limit:
                    best_diff = diff
                    best_factors = f + (i,)
                    break
            else:
                break
            i += 1
        factors.append(best_factors)
    return factors

def find_factors(n):
    best_pair = (1, n)
    best_diff = n - 1
    for i in range(2, int(n ** 0.5) + 1):
        if n % i == 0:
            pair = (i, n // i)
            diff = abs(pair[0] - pair[1])
            if diff < best_diff:
                best_diff = diff
                best_pair = pair
    return best_pair

factors = closest_factors(numbers, limit)
print(factors)
# ---------- end python_2 ----------
split_5 = TextSplit(Text=item_18, Separators=",")  # disabled
addition = Addition(A=series_3, B=Slider(7, range=0..10))
rectangle = Rectangle(Plane=pt_4, XSize=Domain(-1, 1), YSize="-1.5 to 1.5", Radius=0)  # -> graft(Rectangle), Length

# ---- group: string-list
cluster_2 = Cluster(T=python_2.factors)

# ----
rectangle_2 = Rectangle(Plane=pt_4, XSize=Domain(-1, 1), YSize=Domain(-2, 2), Radius=0)  # -> graft(Rectangle), Length
Y = UnitY(Factor=addition)
pop2d = Populate2D(Region=graft(rectangle.Rectangle), Count=lng_5, Seed=1)
int_4 = Integer(cluster_2)
item_19 = ListItem(List=int_4, Index="-1", Wrap=True)

# ---- group: Calculate Colour Distance
panel_5 = Panel("0")  # disabled
item_20 = ListItem(List=split_5, Index=panel_5, Wrap=True)  # disabled
item_21 = ListItem(List=merge, Index=panel_5, Wrap=True)  # disabled
expression = Expression(R1=item_20, R2=flatten(item_21), Expression="(R2 - R1)²")  # -> simplify(R); disabled

panel_6 = Panel("1")  # disabled
item_22 = ListItem(List=split_5, Index=panel_6, Wrap=True)  # disabled
item_23 = ListItem(List=merge, Index=panel_6, Wrap=True)  # disabled
expression_2 = Expression(G1=item_22, G2=flatten(item_23), Expression="(G2 - G1)²")  # -> simplify(R); disabled

panel_7 = Panel("2")  # disabled
item_24 = ListItem(List=split_5, Index=panel_7, Wrap=True)  # disabled
item_25 = ListItem(List=merge, Index=panel_7, Wrap=True)  # disabled
expression_3 = Expression(B1=item_24, B2=flatten(item_25), Expression="(B2 - B1)²")  # -> simplify(R); disabled

# ----
move_3 = Move(Geometry=rectangle.Rectangle, Motion=Y)  # -> Geometry, Transform
preview_4 = CustomPreview(Geometry=pop2d, Material=branch_5)
smesh = SimpleMesh(Brep=move_3.Geometry)
cull_i = CullIndex(List=int_4, Indices="-1", Wrap=True)
panel_8 = Panel(lng_5)
lng_6 = ListLength(List=flatten(txt_4))  # disabled
boundary_2 = BoundarySurfaces(Edges=move_3.Geometry)
surfacemap_2 = SurfaceMapping(Mesh=smesh, Surface=boundary_2)
lng_7 = ListLength(List=surfacemap_2)
subtraction = Subtraction(A=lng_7, B=item_19)
series_5 = Series(Start=0, Step=1, Count=subtraction)
item_26 = ListItem(List=area_2.Area, Index=series_5, Wrap=True)
item_27 = ListItem(List=branch_6, Index=series_5, Wrap=True)
item_28 = ListItem(List=branch_7, Index=series_5, Wrap=True)
item_29 = ListItem(List=surfacemap_2, Index=series_5, Wrap=True)
series_6 = Series(Start=0, Step=1, Count=lng_6)  # disabled
brec_2 = BoundingRectangle(Geometry=graft(surfacemap_2), Plane=PlaneXY(0, 0, 0), Axis=0, Slide=0, Union=True)  # -> Bounding, DimensionX, DimensionY
sort_3 = SortList(Keys=item_26, ValuesA=item_28, ValuesB=item_27)  # -> Keys, reverse(ValuesA), reverse(ValuesB)
addition_2 = Addition(A=expression, B=expression_2, C=expression_3)  # disabled
sqrt = SquareRoot(Value=addition_2)  # disabled
data_2 = Data(Tree({0;0}: [3, 5], {1;0}: [4, 4], {2;0}: [4, 7], {3;0}: [4, 4], {4;0}: [1, 7], {5;0}: [7, 8]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))
previewmat_2 = CustomPreviewMaterials(Geometry=item_29, DiffuseColor=RGB(255, 255, 255), DiffuseBitmap=sort_3.ValuesA)
panel_9 = Panel("C:\Users\Matthew\OneDrive\My Documents\home\projects\skywall\gh-project-folder\$_process-colours\sky-photos")
sort_4 = SortList(Keys=sqrt, ValuesA=series_6)  # -> Keys, ValuesA; disabled

# ---- group: Limit Image Repitition (shit needs work)
tstat_5 = TreeStatistics(Tree=sort_4.ValuesA)  # -> Paths, Length, Count; disabled
repeat_2 = RepeatData(Data="0", Length=tstat_5.Count)  # disabled
loop_start = LoopStart(Repeat=Slider(0, range=0..100), Trigger=Button(), Data=repeat_2)  # -> port, Counter, Data; disabled
data_3 = Data(loop_start.Data)  # disabled
item_30 = ListItem(List=sort_4.ValuesA, Index=graft(data_3), Wrap=True)  # disabled
flatten = FlattenTree(Tree=item_30, Path="{0}")  # disabled
cset = CreateSet(List=flatten(flatten))  # -> Set, Map; disabled
mindex = MemberIndex(Set=flatten, Member=cset.Set)  # -> Index, Count; disabled
lng_8 = ListLength(List=mindex.Index)  # disabled
series_7 = Series(Start=0, Step=1, Count=lng_8)  # disabled
sort_5 = SortList(Keys=flatten(mindex.Index), ValuesA=flatten(series_7))  # -> Keys, ValuesA; disabled
addition_3 = Addition(A=data_3, B=sort_5.ValuesA)  # disabled
loop_end = LoopEnd(port=loop_start.port, Exit=False, Data=addition_3, TimeOutVal=0, pausedState=False, state="Constant output")  # disabled

# ----
panel_10 = Panel(cull_i)
panel_11 = Panel("C:\Users\Matthew\OneDrive\My Documents\home\projects\skywall\gh-project-folder\$_process-colours\sky-photos")
branch_9 = TreeBranch(Tree=sort_3.ValuesA, Path="24", MaintainPaths=True)
data_4 = Data(["`/Sky_01/sky_342.jpg`,", "`/www.google.com/pink_sky_-_Google_Search/10001.jpg`,", "`/home/20220302_183618.jpg`,", "`/www.google.com/pink_sky_-_Google_Search/10063.jpg`,", "`/www.google.com/pink_sky_-_Google_Search/10022 (1).jpg`,", "`/Sky_01/sky_315.jpg`,", "`/www.google.com/pink_sky_-_Google_Search/10066.jpg`,", "`/www.google.com/pink_sky_-_Google_Search/10069.jpg`,", "`/www.google.com/pink_sky_-_Google_Search/10064.jpg`,", "`/www.google.com/pink_sky_-_Google_Search/10012 (1).jpg`,", "`/www.google.com/pink_sky_-_Google_Search/10042.jpg`,", "`/www.google.com/pink_sky_-_Google_Search/10017.jpg`,", "`/www.google.com/sky_sunset_pink_clouds_-_Google_Search/10057.jpg`,", "`/www.google.com/pink_sky_-_Google_Search/10059.jpg`,", "`/www.google.com/pink_sky_-_Google_Search/10057.jpg`,", "`/www.google.com/pink_sky_-_Google_Search/10068 (1).jpg`,", "`/www.google.com/pink_sky_-_Google_Search/10066 (1).jpg`,", "`/Sky_01/sky_234.jpg`,", "`/www.google.com/sky_sunset_pink_clouds_-_Google_Search/10045.jpg`,", "`/www.google.com/sky_sunset_pink_clouds_-_Google_Search/10017.jpg`,", "`/www.google.com/sky_sunset_pink_clouds_-_Google_Search/10001.jpg`,", "`/www.google.com/pink_sky_-_Google_Search/10051.jpg`,", "`/home/20220706_213820_1.jpg`,", "`/www.google.com/sky_sunset_pink_clouds_-_Google_Search/10052.jpg`,", "`/www.google.com/pink_sky_-_Google_Search/10037 (1).jpg`,", "`/www.google.com/sky_sunset_pink_clouds_-_Google_Search/10040.jpg`,", "`/www.google.com/sky_sunset_pink_clouds_-_Google_Search/10039.jpg`,", "`/www.google.com/pink_sky_-_Google_Search/10059 (1).jpg`,", "`/Sky_02/sky.arena_68.jpg`,", "`/www.google.com/sky_sunset_pink_clouds_-_Google_Search/10065.jpg`,", "`/Sky_02/sky.arena_52.jpg`,", "`/www.google.com/sky_sunset_pink_clouds_-_Google_Search/10033.jpg`,", "`/www.google.com/sky_sunset_pink_clouds_-_Google_Search/10055.jpg`,", "`/www.google.com/pink_sky_-_Google_Search/10043.jpg`,", "`/www.google.com/pink_sky_-_Google_Search/10013.jpg`,", "`/www.google.com/pink_sky_-_Google_Search/10010.jpg`,", "`/www.google.com/pink_sky_-_Google_Search/10016.jpg`,", "`/www.google.com/pink_sky_-_Google_Search/10026.jpg`,", "`/Sky_02/sky.arena_38.jpg`,", "`/www.google.com/01/10056.jpg`,", "`/www.google.com/pink_sky_-_Google_Search/10012.jpg`,", "`/www.google.com/pink_sky_-_Google_Search/10041.jpg`,"])
concat_4 = Concatenate(FragmentA="`", FragmentB=branch_9, FragmentC="`", FragmentD=",")
panel_12 = Panel(data_4)
branch_10 = TreeBranch(Tree=sort_3.ValuesA, Path="11", MaintainPaths=True)
rep = ReplaceText(Text=concat_4, Find=panel_9, RecursiveReplace=False)
rep_2 = ReplaceText(Text=rep, Find="\", Replace="/", RecursiveReplace=False)
concat_5 = Concatenate(FragmentA="`", FragmentB=branch_10, FragmentC="`", FragmentD=",")
rep_3 = ReplaceText(Text=concat_5, Find=panel_11, RecursiveReplace=False)
rep_4 = ReplaceText(Text=rep_3, Find="\", Replace="/", RecursiveReplace=False)
panel_13 = Panel(rep_4)

# ---- group: Match Index's
data_5 = Data(loop_end)  # disabled
panel_14 = Panel("0")
item_31 = ListItem(List=sort_4.ValuesA, Index=graft(data_5), Wrap=True)  # disabled

# ----
item_32 = ListItem(List=txt_4, Index=flatten(item_31), Wrap=True)  # disabled
item_33 = ListItem(List=col_2, Index=flatten(item_31), Wrap=True)  # disabled
srf_5 = Surface(srf_4)  # disabled
panel_15 = Panel("C:\cWeb\projects\skywall-demo\public\assets\mesh\buildng.gltf")
mesh_3 = MeshBrep(
    Brep=srf_5,
    Settings={GridMaxCount=0, GridMinCount=16, JaggedSeams=False, MaxEdgeLength=0, MinEdgeLength=0.0001, MinTolerance=0, Refine=True, RefineAngle=0, RelativeTolerance=0.65, SimplePlanes=True, Tolerance=0})  # disabled
number_slider_6 = Slider(22, range=0..1000)
txt_5 = Text(concat)
surfacemap_3 = SurfaceMapping(Mesh=mesh_3, Surface=srf_5)  # disabled

# ---- group: Input Colour at surface center
partition_3 = PartitionList(List=col, Size=flatten(lng_4))  # disabled

# ---- group: Closest Dominat Sky Photo Colour
partition_4 = PartitionList(List=item_33, Size=flatten(lng_4))  # disabled

# ---- group: Path to matching sky image
partition_5 = PartitionList(List=item_32, Size=flatten(lng_4))  # disabled

# ----
neg = Negative(Value=number_slider_6)
X_3 = UnitX(Factor=Slider(44, range=0..100))
pcimportobj = ImportOBJ(File=txt_5, MapYtoZ=True, LastSaveLocalization="neutral,N")
dom = ConstructDomain(DomainStart=neg, DomainEnd=number_slider_6)
bbox = BoundingBox(Content=flatten(surfacemap_3), Plane=PlaneXY(0, 0, 0), UnionBox=True)  # -> Box, Box_2; disabled
move_4 = Move(Geometry=pt_3, Motion=X_3)  # -> Geometry, Transform; disabled
move_5 = Move(Geometry=surfacemap_3, Motion=X_3)  # -> Geometry, Transform; disabled
geo_2 = Geometry(geo)
truebutton = TrueOnlyButton(LastSaveLocalization="neutral,N")
box = CenterBox(Base=PlaneXY(0, 0, 0), X=dom, Y=dom, Z=dom)
scale = Scale(Geometry=pcimportobj, Center=Point(0, 0, 0), Factor="0.001")  # -> Geometry, Transform
boundary_3 = BoundarySurfaces(Edges=geo_2)  # -> reparameterize(Surfaces)
lng_9 = ListLength(List=flatten(surfacemap_3))  # disabled
previewmat_3 = CustomPreviewMaterials(Geometry=surfacemap_3, DiffuseColor=RGB(255, 255, 255), DiffuseBitmap=partition_5)  # disabled
preview_5 = CustomPreview(Geometry=move_4.Geometry, Material=partition_3)  # disabled
preview_6 = CustomPreview(Geometry=move_5.Geometry, Material=partition_4)  # disabled
evalsrf = EvaluateSurface(Surface=reparameterize(boundary_3), Point="0.5,0.5")  # -> Point, Normal, UDirection, VDirection, Frame
random = Random(Range="0 to 360", Number=lng_9, Seed=Slider(22, range=0..100))  # disabled
pop3d = Populate3D(Region=box, Count=lng_9, Seed=1)  # disabled
random_2 = Random(Range="0 to 360", Number=lng_9, Seed=2)  # disabled
random_3 = Random(Range="0 to 360", Number=lng_9, Seed=Slider(15, range=0..100))  # disabled
orient = Orient(Geometry=geo_2, Source=evalsrf.Frame, Target=PlaneXY(0, 0, 0))  # -> Geometry, Transform
area_3 = Area(Geometry=surfacemap_3)  # -> graft(Area), graft(Centroid); disabled
mjoin = MeshJoin(Meshes=scale.Geometry)
transform = Transform(Geometry=geo_2, Transform=orient.Transform)
rnd_vector = RandomVector(Number=12, Length=Domain(1, 5))
pcexportas = ExportAs(
    Geometry=mjoin,
    FileLocation=panel_15,
    Overwrite=True,
    Export=truebutton,
    CompMode=False,
    LastSaveLocalization="neutral,N")  # -> OK, ExportCommand
vec2pt = Vector2Pt(PointA=graft(area_3.Centroid), PointB=graft(pop3d), Unitize=False)  # -> Vector, Length; disabled
move_6 = Move(Geometry=graft(surfacemap_3), Motion=vec2pt.Vector)  # -> Geometry, Transform; disabled
roteuler = RotateEuler(
    Geometry=flatten(move_6.Geometry),
    Plane=flatten(pop3d),
    Axis1=0,
    Axis2=1,
    Axis3=2,
    Degrees1=random_2,
    Degrees2=random,
    Degrees3=random_3)  # -> graft(Rotated), Plane1, Plane2, Plane3, Transform; disabled
transform_2 = Transform(Geometry=surfacemap_3, Transform=graft(orient.Transform))  # disabled
data_6 = Data(graft(transform))
resolution_factor = Slider(100, range=0..1000)

# ---- group: to save png double click clock to reset + set rhino viewport to top
save = Button()
clock = Clock(SecondHand=True)

# ----
brec_3 = BoundingRectangle(Geometry=data_6, Plane=PlaneXY(0, 0, 0), Axis=0, Slide=0, Union=True)  # -> Bounding, flatten(DimensionX), flatten(DimensionY)
demesh_2 = DeconstructMesh(Mesh=roteuler.Rotated)  # -> flatten(Vertices), Faces, Colours, Normals; disabled
demesh_3 = DeconstructMesh(Mesh=surfacemap_3)  # -> flatten(Vertices), Faces, Colours, Normals; disabled
number_slider_7 = Slider(3, range=0..10)
number_slider_8 = Slider(3, range=0..10)
number_slider_9 = Slider(3, range=0..10)
series_8 = Series(Start=0, Step=1, Count="4")  # -> graft(Series)
series_9 = Series(Start=0, Step="20", Count="4")  # -> graft(Series)
ins_2 = InsertItems(List=brec_3.DimensionX, Item="0", Indices="0", Wrap=True)
pdecon_2 = Deconstruct(Point=demesh_2.Vertices)  # -> XComponent, YComponent, ZComponent; disabled
boundary_4 = BoundarySurfaces(Edges=geo_2)  # -> graft(Surfaces)
pdecon_3 = Deconstruct(Point=demesh_3.Vertices)  # -> XComponent, YComponent, ZComponent; disabled
ma = MassAddition(Input=ins_2)  # -> Result, PartialResults
Y_2 = UnitY(Factor=series_9)
move_7 = Move(Geometry=transform_2, Motion=Y_2)  # -> Geometry, Transform; disabled
data_7 = Data(move_7.Geometry)  # disabled
panel_16 = Panel("C:\cWeb\projects\skywall-demo\public\assets\mesh\skiesmesh.gltf")
cull_i_2 = CullIndex(List=ma.PartialResults, Indices="4", Wrap=True)
shift = ShiftList(List=ma.PartialResults, Shift=1, Wrap=False)
roundd = RoundToDecimalPlace(NumberX=pdecon_3.XComponent, DecimalPlace=number_slider_8, RoundType=0)  # -> Rounded, Difference; disabled
roundd_2 = RoundToDecimalPlace(NumberX=pdecon_3.YComponent, DecimalPlace=number_slider_8, RoundType=0)  # -> Rounded, Difference; disabled
roundd_3 = RoundToDecimalPlace(NumberX=pdecon_3.ZComponent, DecimalPlace=number_slider_8, RoundType=0)  # -> Rounded, Difference; disabled
roundd_4 = RoundToDecimalPlace(NumberX=pdecon_2.XComponent, DecimalPlace=number_slider_7, RoundType=0)  # -> Rounded, Difference; disabled
roundd_5 = RoundToDecimalPlace(NumberX=pdecon_2.YComponent, DecimalPlace=number_slider_7, RoundType=0)  # -> Rounded, Difference; disabled
roundd_6 = RoundToDecimalPlace(NumberX=pdecon_2.ZComponent, DecimalPlace=number_slider_7, RoundType=0)  # -> Rounded, Difference; disabled
surfacemap_4 = SurfaceMapping(Mesh=surfacemap_3, Surface=boundary_4)  # disabled
calendar = Calendar()
pt_5 = ConstructPoint(XCoordinate=cull_i_2, YCoordinate=0, ZCoordinate=0)
dom_2 = ConstructDomain(DomainStart=0, DomainEnd=brec_3.DimensionX)
dom_3 = ConstructDomain(DomainStart=0, DomainEnd=brec_3.DimensionY)
concat_6 = Concatenate(FragmentA=roundd_4.Rounded, FragmentB=",", FragmentC=roundd_6.Rounded, FragmentD=",", FragmentE=roundd_5.Rounded)  # disabled
concat_7 = Concatenate(FragmentA=roundd.Rounded, FragmentB=",", FragmentC=roundd_3.Rounded, FragmentD=",", FragmentE=roundd_2.Rounded)  # disabled
X_4 = UnitX(Factor="170")
move_8 = Move(Geometry=transform_2, Motion=X_4)  # -> Geometry, Transform; disabled
rectangle_3 = Rectangle(Plane=pt_5, XSize=dom_2, YSize=dom_3, Radius=0)  # -> Rectangle, Length
concat_8 = Concatenate(FragmentB=concat_6, FragmentC=",")  # disabled
cdate = CombineDateTime(Date=calendar, Time=clock)
concat_9 = Concatenate(FragmentB=concat_7, FragmentC=",")  # disabled
branch_11 = TreeBranch(Tree=simplify(partition_5), Path=series_8, MaintainPaths=True)  # disabled
area_4 = Area(Geometry=flatten(data_6))  # -> Area, Centroid
truebutton_2 = TrueOnlyButton(LastSaveLocalization="neutral,N")
ddate = DeconstructDate(Date=cdate)  # -> Year, Month, Day, Hour, Minute, Second
area_5 = Area(Geometry=rectangle_3.Rectangle)  # -> Area, Centroid
yz = YZPlane(Origin=area_5.Centroid)
join = TextJoin(Text=concat_8)  # disabled
join_2 = TextJoin(Text=concat_9)  # disabled
vec2pt_2 = Vector2Pt(PointA=area_4.Centroid, PointB=area_5.Centroid, Unitize=False)  # -> Vector, Length
move_9 = Move(Geometry=transform_2, Motion=graft(vec2pt_2.Vector))  # -> Geometry, Transform; disabled
mirror = Mirror(Geometry=move_9.Geometry, Plane=graft(yz))  # -> Geometry, Transform; disabled
demesh_4 = DeconstructMesh(Mesh=mirror.Geometry)  # -> flatten(Vertices), Faces, Colours, Normals; disabled
pdecon_4 = Deconstruct(Point=demesh_4.Vertices)  # -> XComponent, YComponent, ZComponent; disabled
roundd_7 = RoundToDecimalPlace(NumberX=pdecon_4.XComponent, DecimalPlace=number_slider_9, RoundType=0)  # -> Rounded, Difference; disabled
roundd_8 = RoundToDecimalPlace(NumberX=pdecon_4.YComponent, DecimalPlace=number_slider_9, RoundType=0)  # -> Rounded, Difference; disabled
roundd_9 = RoundToDecimalPlace(NumberX=pdecon_4.ZComponent, DecimalPlace=number_slider_9, RoundType=0)  # -> Rounded, Difference; disabled
mjoin_2 = MeshJoin(Meshes=flatten(mirror.Geometry))  # disabled
concat_10 = Concatenate(FragmentA=roundd_7.Rounded, FragmentB=",", FragmentC=roundd_9.Rounded, FragmentD=",", FragmentE=roundd_8.Rounded)  # disabled
concat_11 = Concatenate(FragmentB=concat_10, FragmentC=",")  # disabled
join_3 = TextJoin(Text=concat_11)  # disabled
concat_12 = Concatenate(
    FragmentA=ddate.Month,
    FragmentB="_",
    FragmentC=ddate.Day,
    FragmentD="_",
    FragmentE=ddate.Hour,
    FragmentG="_",
    FragmentF=ddate.Minute)
concat_13 = Concatenate(FragmentD="export const rnVertexPos =", FragmentA="[", FragmentB=join, FragmentC="]")  # disabled
concat_14 = Concatenate(FragmentD="export const fnVertexPos =", FragmentA="[", FragmentB=join_2, FragmentC="]")  # disabled
concat_15 = Concatenate(FragmentD="export const flatVertexPos =", FragmentA="[", FragmentB=join_3, FragmentC="]")  # disabled
brec_4 = BoundingRectangle(Geometry=flatten(mirror.Geometry), Plane=PlaneXY(0, 0, 0), Axis=0, Slide=0, Union=True)  # -> Bounding, DimensionX, DimensionY; disabled
surfacemap_5 = SurfaceMapping(Mesh=mjoin_2, Surface=brec_4.Bounding)  # disabled
move_10 = Move(Geometry=transform, Motion=X_4)  # -> Geometry, Transform
item_34 = ListItem(List=graft(move_10.Geometry), Index=series_8, Wrap=True)
rec = Rectangle(item_34)
move_11 = Move(Geometry=transform, Motion=X_4)  # -> Geometry, Transform
item_35 = ListItem(List=graft(move_11.Geometry), Index=series_8, Wrap=True)
rec_2 = Rectangle(item_35)
previewmat_4 = CustomPreviewMaterials(Geometry=mirror.Geometry, DiffuseColor=RGB(255, 255, 255), DiffuseBitmap=branch_11)  # disabled
move_12 = Move(Geometry=rec, Motion=Y_2)  # -> Geometry, Transform
move_13 = Move(Geometry=rec_2, Motion=Y_2)  # -> Geometry, Transform
pcexportas_2 = ExportAs(
    Geometry=surfacemap_5,
    FileLocation=panel_16,
    Overwrite=True,
    Export=truebutton_2,
    CompMode=False,
    LastSaveLocalization="neutral,N")  # -> OK, ExportCommand; disabled
txt_6 = Text(concat_3)
txt_7 = Text(concat_3)
concat_16 = Concatenate(FragmentA=concat_15, FragmentC=" ", FragmentB=concat_14, FragmentD=" ", FragmentE=concat_13)  # disabled
concat_17 = Concatenate(FragmentA=concat_12, FragmentE="_screen_", FragmentB=series_8)
concat_18 = Concatenate(FragmentA=concat_12, FragmentE="_screen_", FragmentB=series_8)
output_path = Panel(txt_6)
save_2 = Button()
wrtietext = WrtieText(filePath="C:\cWeb\projects\skywall-demo\src\dataset\meshData.js", data=concat_16, activate=Toggle(True))  # -> out, A; inputs data: list; disabled
# ---------- wrtietext: VB ----------
    If activate Then

      Dim i As Integer
      Dim aryText(4) As String

      aryText(0) = "Mary WriteLine"
      aryText(1) = "Had"
      aryText(2) = "Another"
      aryText(3) = "Little"
      aryText(4) = "One"

      ' the data is appended to the file. If file doesnt exist, a new file is created
      Dim objWriter As New System.IO.StreamWriter(filePath, append)

      For i = 0 To data.Count - 1
        objWriter.WriteLine(data(i))
      Next

      objWriter.Close()

    End If

    If clearFile Then
      Dim objWriter As New System.IO.StreamWriter(filePath, False)
      objWriter.Close()
    End If
# ---------- end wrtietext ----------
python_3 = GhPythonScript(frame=move_12.Geometry, factor=resolution_factor, path=txt_6, filename=concat_17, save=save)  # inputs frame: Polyline, save: Boolean
# ---------- python_3: Python ----------
import Rhino.Geometry as rg
import Rhino.Display as rd
import scriptcontext as sc
import System, operator

# Get x and y coordinates of frame vertices
px, py = set(frame.X), set(frame.Y)

# Get horizontal and vertical lengths
dx = abs(reduce(operator.sub, px))
dy = abs(reduce(operator.sub, py))

# Construct the points that will set the print area
offx = (dx/dy) * (3/factor)
offy = (dy/dx )* (3/factor)
p1 = rg.Point3d(min(px) + offx, min(py) + offy, 0)
p2 = rg.Point3d(max(px) - offx, max(py) - offy, 0)

# Set resolution to chosen scaling factor
sx, sy = dx*factor, dy*factor


def Capture():

    view = sc.doc.Views.ActiveView
    size = System.Drawing.Size(sx, sy) 

    settings = rd.ViewCaptureSettings(view, size, 300) #view, size, dpi
    settings.SetWindowRect(p1, p2)
    settings.RasterMode = True
    settings.DrawGrid = False
    settings.DrawAxis = False
    settings.DrawWallpaper = False

    bitmap = rd.ViewCapture.CaptureToBitmap(settings)
    bitmap.Save(path+filename+".png")


if save:
    Capture()
# ---------- end python_3 ----------
python_4 = GhPythonScript(
    frame=brec_4.Bounding,
    factor=resolution_factor,
    path="C:\cWeb\projects\skywall-demo\public\assets\textures\",
    filename="text",
    save=save_2)  # inputs frame: Polyline, save: Boolean; disabled; same code as python_3

# ==== cluster Cluster
T = ClusterInput()
rep = ReplaceText(Text=T, Find="(", RecursiveReplace=False)
rep_2 = ReplaceText(Text=rep, Find=")", RecursiveReplace=False)
rep_3 = ReplaceText(Text=rep_2, Find=" ", RecursiveReplace=False)
split = TextSplit(Text=rep_3, Separators=",")  # -> simplify(Result)
R = ClusterOutput(split)
